# Grasshopper definition hugad_device_v0.0.ghx (Grasshopper 1.0.8)
# Copyright: 2024
# plug-ins: RhinoCodePluginGH, MeshEdit Components, Pufferfish, SurfacePlus

pt = ConstructPoint(XCoordinate=0, YCoordinate=0, ZCoordinate=0)
pt_2 = ConstructPoint(XCoordinate=0, YCoordinate=Slider(24, range=0..100), ZCoordinate=Slider(113, range=0..1000))
number_slider = Slider(0.712, range=0..1)
ln = Line(StartPoint=pt, EndPoint=pt_2)
number_slider_2 = Slider(4, range=0..100)
eval = EvaluateCurve(Curve=reparameterize(ln), Parameter=number_slider)  # -> Point, Tangent, Angle
Y = UnitY(Factor=Slider(8.835, range=0..100))
move = Move(Geometry=eval.Point, Motion=expr("-x", Y))  # -> Geometry, Transform
range = Range(Domain=Domain(0, 1), Steps=number_slider_2)
arc = Arc3Pt(PointA=pt, PointB=move.Geometry, PointC=pt_2)  # -> Arc, Plane, Radius
pframe = PerpFrame(Curve=reparameterize(arc.Arc), Parameter=range)
pframe_2 = PerpFrame(Curve=reparameterize(arc.Arc), Parameter=number_slider)
X = UnitX(Factor=1)
align = AlignPlane(Plane=pframe, Direction=X)  # -> Plane, Angle

number_slider_3 = Slider(15, range=0..100)
dom = ConstructDomain(DomainStart=Slider(80, range=0..100), DomainEnd=number_slider_3)
dom_2 = ConstructDomain(DomainStart=Slider(20, range=0..100), DomainEnd=number_slider_3)

x_segements = Slider(3, range=1..100)
y_segements = Slider(1, range=1..10)
range_2 = Range(Domain=Domain(1, 0), Steps=number_slider_2)
graph = GraphMapper(range_2, x0=0, x1=1, y0=0, y1=1, container_name="Bezier", cpx=[0, 0.25, 0.75, 1], cpy=[0, 0.25, 0.75, 1])

graph_2 = GraphMapper(range_2, x0=0, x1=1, y0=0, y1=1, container_name="Gaussian", factor=0.2649286389, mean=0.5014343262, sdev=0.1127069592)
dom_3 = ConstructDomain(DomainStart=Slider(15.32, range=0..100), DomainEnd=0)
dom_4 = ConstructDomain(DomainStart=Slider(7, range=0..100), DomainEnd=Slider(3.82, range=0..100))
remap = RemapNumbers(Value=graph_2, Source=Domain(1, 0), Target=dom_3)  # -> Mapped, Clipped
range_3 = Range(Domain=dom_4, Steps=number_slider_2)  # -> graft(Range)
entwine = Entwine(
    Branch00=align.Plane,
    Branch01=dom,
    Branch02=dom_2,
    Branch03=number_slider_2,
    Branch04=x_segements,
    Branch05=y_segements,
    Branch06=Slider(10.46, range=0..100),
    Branch07=graph,
    Branch08=range_3,
    Branch09=remap.Mapped,
    FlattenInputs=True)
data = Data(entwine)
bang = ExplodeTree(Data=data)  # -> Branch0, Branch1, Branch2, Branch3, Branch4, Branch5, Branch6, Branch7, graft(Branch8), Branch9
cluster = Cluster(
    plane=bang.Branch0,
    length_range=bang.Branch1,
    width_range=bang.Branch2,
    steps=bang.Branch3,
    x_segements=bang.Branch4,
    y_segements=bang.Branch5,
    bend=bang.Branch6,
    bend_graph=bang.Branch7,
    chamfer=bang.Branch8,
    inner_convexity=bang.Branch9)  # -> segment_points, middle_polyline
item = ListItem(List=flatten(cluster.middle_polyline), Index=0, Wrap=True)  # -> Item1, Item
pline = PolyLine(Vertices=cluster.segment_points, Closed=True)  # -> flatten(Polyline)
deplane = DeconstructPlane(Plane=bang.Branch0)  # -> Origin, XAxis, YAxis, ZAxis
tstat = TreeStatistics(Tree=cluster.segment_points)  # -> Paths, Length, Count
item_2 = ListItem(List=tstat.Paths, Index=0, Wrap=True)  # -> Item1, Item
item_3 = ListItem(List=deplane.ZAxis, Index=0, Wrap=True)  # -> Item1, Item
branch = TreeBranch(Tree=cluster.segment_points, Path=item_2.Item, MaintainPaths=True)
branch_2 = TreeBranch(Tree=cluster.segment_points, Path=item_2.Item1, MaintainPaths=True)
number_slider_4 = Slider(3.37, range=0..10)
neg = Negative(Value=Slider(3, range=0..10))
cluster_2 = Cluster_2(edge_points=branch_2, edge_vector=item_3.Item1, chamfer=number_slider_4)
cluster_3 = Cluster_2(edge_points=branch, edge_vector=item_3.Item, chamfer=neg)
shift = ShiftList(List=cluster_3, Shift=1, Wrap=True)
addition = Addition(A=number_slider_4, B=Slider(1.391, range=0..10))
entwine_2 = Entwine(Branch00=cluster_2, Branch01=cluster_3, FlattenInputs=True)
pline_2 = PolyLine(Vertices=shift, Closed=True)
points = PointList(Points=shift, Size=2.35)
amp = Amplitude(Vector=item_3.Item1, Amplitude=addition)
disc = Discontinuity(Curve=pline_2, Level=1)  # -> Points, Parameters
face_indices = Python3Script(V=disc.Points)  # -> Faces; inputs V: list of Point3d
# ---------- face_indices: Python ----------
from math import ceil
face_n = int((len(V)-2)/2)

n = [i for i in range(len(V))]
Faces = []
for i in range(face_n):
    cb = '{}'
    ch = f'Q{cb[0]}{n[0]};{n[1]};{n[-2]};{n[-1]}{cb[1]}'
    Faces.append(ch)
    n.pop(-1)
    n.pop(0)

print(Faces)
# ---------- end face_indices ----------
move_2 = Move(Geometry=item.Item1, Motion=amp)  # -> Geometry, Transform
pline_3 = PolyLine(Vertices=entwine_2, Closed=True)  # -> flatten(Polyline)
conmesh = ConstructMesh(Vertices=disc.Points, Faces=face_indices)
entwine_3 = Entwine(Branch00=move_2.Geometry, FlattenInputs=True)
ins = InsertItems(List=pline, Item=pline_3, Indices=[-1, 0], Wrap=True)
midpt = CurveMiddle(Curve=entwine_3)
paramloftmsh = ParameterLoftMesh(
    Sections=ins,
    ParametersU=[0, 0.1, 0.2, 0.3, 0.4, 0.5, 0.6, 0.7, 0.8, 0.9, 1],
    ParametersV=[0, 1],
    Weighted=False,
    Lengths=True,
    Angle=0,
    Closed=False,
    Triangulate=False)
py3 = Python3Script(cen=graft(midpt), pts=cluster_2)  # -> a; inputs cen: Point3d, pts: list of Point3d
# ---------- py3: Python ----------
import Rhino.Geometry as rg 

a = rg.Mesh()
pts.append(pts[0])
for i in range(len(pts) - 1):
    pl = rg.Polyline()
    pl.Add(cen)
    pl.Add(pts[i])
    pl.Add(pts[i + 1])
    pl.Add(cen)
    mesh = rg.Mesh.CreateFromClosedPolyline(pl)
    a.Append(mesh)
a.Weld(0.01)
# ---------- end py3 ----------
mjoin = MeshJoin(Meshes=flatten([paramloftmsh, py3, conmesh]))
weldvertices = MeshWeldVertices(Mesh=mjoin, Tolerance=0.01)  # -> RuntimeMessage, Mesh
unim = UnifyMesh(Mesh=weldvertices.Mesh)  # -> Result, Count
subdmesh = SubDFromMesh(Mesh=unim.Result, Creases=1, Corners=1, Interpolate=False)
offmsh = OffsetMesh(Mesh=unim.Result, Distance=expr("-x", 1), BothSides=0, CreateSolid=False)
subdpoly = SubDControlPolygon(SubD=subdmesh)
subdmesh_2 = SubDFromMesh(Mesh=offmsh, Creases=1, Corners=1, Interpolate=False)
medges = MeshEdges(Mesh=subdpoly)  # -> NakedEdges, InteriorEdges, NonManifoldEdges
subd_to_nurbs = Python3Script(S=subdmesh, Ex=Slider(4, range=0..10))  # -> B; inputs Ex: Int32
#   port Ex: None = 0 LocalG1 = 1 LocalG2 = 2 LocalG1x = 3 LocalG1xx = 4
# ---------- subd_to_nurbs: Python ----------
import Rhino.Geometry as rg
if Ex > 4:
    raise ValueError('This option doesn\'nt exist. (0, 4)')
opt = rg.SubDToBrepOptions()
opt.PackFaces = True
evp = rg.SubDToBrepOptions.ExtraordinaryVertexProcessOption(Ex)
opt.ExtraordinaryVertexProcess = evp
B = S.ToBrep(opt)
# ---------- end subd_to_nurbs ----------

# ---- group: Calculate Dimensions
bbox = BoundingBox(Content=subdmesh, Plane=pframe_2)  # -> Box, Box_2
edges = BrepEdges(Brep=bbox.Box)  # -> Naked, Interior, NonManifold
py3_2 = Python3Script(B=bbox.Box)  # -> pts, U, V, W; inputs B: Box
# ---------- py3_2: Python ----------
import Rhino.Geometry as rg
pts = B.GetCorners()
U = B.X[1] - B.X[0]
V = B.Y[1] - B.Y[0]
W = B.Z[1] - B.Z[0]
# ---------- end py3_2 ----------
item_4 = ListItem(List=py3_2.pts, Index=0, Wrap=True)  # -> Item, Item1, Item2, Item3, Item4
ln_2 = Line(StartPoint=item_4.Item, EndPoint=item_4.Item1)
ln_3 = Line(StartPoint=item_4.Item, EndPoint=item_4.Item4)
ln_4 = Line(StartPoint=item_4.Item1, EndPoint=item_4.Item2)

# ----
debrep = DeconstructBrep(Brep=subd_to_nurbs)  # -> Faces, Edges, Vertices
area = Area(Geometry=debrep.Faces)  # -> Area, Centroid
avr = Average(Input=area.Area)
larger = LargerThan(FirstNumber=area.Area, SecondNumber=avr)  # -> LargerThan, OrEqualTo
preview = CustomPreview(Geometry=edges.Interior, Material="white")
curve_preview = CustomCurvePreview(Curve=medges.InteriorEdges, Colour=RGB(0, 0, 0))
linedim = LineDimension(Line=[ln_2, ln_4, ln_3], Text="{0:0.00}", Size=Slider(2.25, range=0..10))
cull = CullPattern(List=debrep.Faces, CullPattern=larger.LargerThan)
item_5 = ListItem(List=cull, Index=0, Wrap=True)  # -> Item, Item1
srf = Surface(item_5.Item1)

number_slider_5 = Slider(0.32, range=0..1)
subtraction = Subtraction(A=1, B=number_slider_5)
dom_5 = ConstructDomain(DomainStart=number_slider_5, DomainEnd=subtraction)
dom_6 = ConstructDomain(DomainStart=number_slider_5, DomainEnd=subtraction)
dom² = ConstructDomain²(DomainU=dom_5, DomainV=dom_6)
subsrf = Isotrim(Surface=reparameterize(item_5.Item1), Domain=dom²)
rebuild = Rebuild(Surface=subsrf, DegreeU=3, DegreeV=3, CountU="10", CountV="10")

sdivide = DivideSurface(Surface=rebuild, UCount=Slider(6, range=0..100), VCount=Slider(3, range=0..100))  # -> Points, Normals, Parameters
intcrv = Interpolate(Vertices=sdivide.Points, Degree=3, Periodic=False, KnotStyle=1)  # -> Curve, Length, Domain
number_slider_6 = Slider(5, range=0..10)
multiplication = Multiplication(A=number_slider_6, B=2)
len = Length(Curve=intcrv.Curve)
addition_2 = Addition(A=multiplication, B=Slider(2.1, range=0..10))
division = Division(A=len, B=addition_2)
int = Integer(division)
divide = DivideCurve(Curve=intcrv.Curve, Count=int, Kinks=False)  # -> Points, Tangents, Parameters
srf_cp = SurfaceClosestPoint(Point=divide.Points, Surface=rebuild)  # -> Point, UVPoint, Distance
evalsrf = EvaluateSurface(Surface=rebuild, Point=srf_cp.UVPoint)  # -> Point, Normal, UDirection, VDirection, Frame
sph = Sphere(Base=evalsrf.Point, Radius=number_slider_6)
cir = Circle(Plane=evalsrf.Frame, Radius=number_slider_6)
srfsplit = SurfaceSplit(Surface=graft(sph), Curves=graft(cir))
item_6 = ListItem(List=srfsplit, Index=0, Wrap=True)
pshift = ShiftPaths(Data=item_6, Offset=-2)  # -> simplify(Data)
cyl = Cylinder(Base=evalsrf.Frame, Radius=number_slider_6, Length=expr("-x", Slider(4.65, range=0..10)))
scale_nu = ScaleNU(Geometry=pshift, Plane=simplify(evalsrf.Frame), ScaleX=1, ScaleY=1, ScaleZ=Slider(0.2, range=0..1))  # -> Geometry, Transform
weave = Weave(Pattern=[0, 1], Stream0=graft(cyl), Stream1=graft(scale_nu.Geometry), NullGaps=False)
join = BrepJoin(Breps=weave)  # -> Breps, Closed
pshift_2 = ShiftPaths(Data=join.Breps, Offset=-2)  # -> simplify(Data)
preview_2 = CustomPreview(Geometry=flatten([subdmesh, subdmesh_2, pshift_2]), Material=ColourSwatch(SwatchColor=RGB(186, 52, 139)))
panel = Panel(pshift_2)

# ==== cluster Cluster
inner_convexity = ClusterInput()
length_range = ClusterInput()
width_range = ClusterInput()
x_segements = ClusterInput()
y_segements = ClusterInput()
bend_graph = ClusterInput()
chamfer = ClusterInput()
plane = ClusterInput()
steps = ClusterInput()
bend = ClusterInput()
range = Range(Domain=width_range, Steps=steps)
dom = ConstructDomain(DomainStart=bend, DomainEnd=0)
range_2 = Range(Domain=length_range, Steps=steps)
division = Division(A=range_2, B=2)
deplane = DeconstructPlane(Plane=plane)  # -> Origin, XAxis, YAxis, ZAxis
X = UnitX(Factor=division)
remap = RemapNumbers(Value=bend_graph, Source=Domain(1, 0), Target=dom)  # -> Mapped, Clipped
parabola = Python3Script(N=x_segements, D="1", Inv="1")  # -> R; inputs N: Int32, D: Int32, Inv: Boolean
#   port N: Number of steps
#   port D: 0 = (0 To 1) 1 = (-1 To 1)
# ---------- parabola: Python ----------
if not N:
    N = 10

types = [(0, 1),
         (-1, 1)]
R = []
start, end = types[D]
diff = end - start
step = diff / N
N += 1
for i in range(N):
    f = (start + i * step) ** 2
    if Inv:
        R.append(end - f)
    else:
        R.append(f)
# ---------- end parabola ----------
multiplication = Multiplication(A=parabola, B=graft(remap.Mapped))
move = Move(Geometry=plane, Motion=expr("-x", X))  # -> Geometry, Transform
move_2 = Move(Geometry=plane, Motion=X)  # -> Geometry, Transform
multiplication_2 = Multiplication(A=graft(deplane.YAxis), B=multiplication)
ln = Line(StartPoint=move.Geometry, EndPoint=move_2.Geometry)
neg = Negative(Value=multiplication_2)
divide = DivideCurve(Curve=ln, Count=x_segements, Kinks=False)  # -> Points, Tangents, Parameters
move_3 = Move(Geometry=divide.Points, Motion=neg)  # -> Geometry, Transform
parabola_2 = Python3Script(N=x_segements, D="1", Inv="1")  # -> R; inputs N: Int32, D: Int32, Inv: Boolean; same code as parabola
pline = PolyLine(Vertices=move_3.Geometry, Closed=False)
multiplication_3 = Multiplication(A=parabola_2, B=graft(inner_convexity))
multiplication_4 = Multiplication(A=graft(deplane.YAxis), B=multiplication_3)
middle_polyline = ClusterOutput(pline)
offset = OffsetCurve(Curve=pline, Distance=expr("x/2", graft(range)), Plane=graft(plane), Corners=1)
offset_2 = OffsetCurve(Curve=pline, Distance=expr("-x/2", graft(range)), Plane=graft(plane), Corners=1)
end = EndPoints(Curve=offset)  # -> Start, End
end_2 = EndPoints(Curve=offset_2)  # -> Start, End
ln_2 = Line(StartPoint=end.Start, EndPoint=end_2.Start)
ln_3 = Line(StartPoint=end.End, EndPoint=end_2.End)
trim_curve = TrimCurve(C=offset, D=chamfer)  # -> Crv; inputs C: Curve, D: Double, E: Int32
#   port E: None = 0 Start = 1 End = 2 Both = 3
# ---------- trim_curve: Python ----------
import Rhino.Geometry as rg
if not E:
    E = 3
if not D:
    D = 0
try:
    if D:
        Crv = C.Trim(rg.CurveEnd(E), D)
    else:
        Crv = C
except:
    pass
# ---------- end trim_curve ----------
trim_curve_2 = TrimCurve(C=offset_2, D=chamfer)  # -> Crv; inputs C: Curve, D: Double, E: Int32; same code as trim_curve
trim_curve_3 = TrimCurve(C=ln_2, D=chamfer)  # -> Crv; inputs C: Curve, D: Double, E: Int32; same code as trim_curve
trim_curve_4 = TrimCurve(C=ln_3, D=chamfer)  # -> Crv; inputs C: Curve, D: Double, E: Int32; same code as trim_curve
divide_2 = DivideCurve(Curve=trim_curve_2, Count=x_segements, Kinks=False)  # -> reverse(Points), Tangents, Parameters
divide_3 = DivideCurve(Curve=trim_curve, Count=x_segements, Kinks=False)  # -> Points, Tangents, Parameters
divide_4 = DivideCurve(Curve=trim_curve_4, Count=y_segements, Kinks=False)  # -> Points, Tangents, Parameters
divide_5 = DivideCurve(Curve=trim_curve_3, Count=y_segements, Kinks=False)  # -> reverse(Points), Tangents, Parameters

# ---- group: Inner Convexity
move_4 = Move(Geometry=divide_2.Points, Motion=multiplication_4)  # -> Geometry, Transform

# ----
group = Group(Objects=divide_5.Points)
group_2 = Group(Objects=divide_3.Points)
group_3 = Group(Objects=move_4.Geometry)
group_4 = Group(Objects=divide_4.Points)
weave = Weave(Pattern=[0, 1, 2, 3], Stream0=group, Stream1=group_2, Stream2=group_4, Stream3=group_3, NullGaps=False)
ungroup = Ungroup(Group=weave)
pshift = ShiftPaths(Data=ungroup, Offset=-1)  # -> simplify(Data)
segment_points = ClusterOutput(pshift)

# ==== cluster Cluster_2
edge_points = ClusterInput()
edge_vector = ClusterInput()
chamfer = ClusterInput()
amp = Amplitude(Vector=edge_vector, Amplitude=chamfer)
move = Move(Geometry=edge_points, Motion=amp)  # -> Geometry, Transform
abs = Absolute(Value=chamfer)
pline = PolyLine(Vertices=move.Geometry, Closed=True)
offset = OffsetCurve(Curve=pline, Distance=expr("-x", abs), Corners=1)
crv_cp = CurveClosestPoint(Point=move.Geometry, Curve=offset)  # -> Point, Parameter, Distance
P = ClusterOutput(crv_cp.Point)
